# Grasshopper definition stl_file_to_edges_and_coordinates.gh (Grasshopper 1.0.7)

mesh = Mesh([<mesh referenced from the Rhino model> x4])

# ---- group: 1. Deconstruct to extract vertices
demesh = DeconstructMesh(Mesh=mesh)  # -> Vertices, Faces, Colours, Normals

# ----
pt = Point(demesh.Vertices)

# ---- group: 2. Remove repeat vertices
cset = CreateSet(List=pt)  # -> Set, Map

# ---- group: 3. Index the vertices
panel = Panel("""0
2""")
# Frame 1
panel_2 = Panel("""0
1""")
item = ListItem(List=cset.Set, Index=panel_2, Wrap=True)
panel_3 = Panel(item)
item_2 = ListItem(List=cset.Set, Index=panel, Wrap=True)
panel_4 = Panel(item_2)
item_3 = ListItem(List=item, Index=0, Wrap=True)  # -> flatten(Item)
item_4 = ListItem(List=item, Index=1, Wrap=True)  # -> flatten(Item)
item_5 = ListItem(List=item_2, Index=1, Wrap=True)  # -> flatten(Item)

# ---- group: 4. Order vertices so robots draws a continuous line
item_6 = ListItem(List=item_3, Index=0, Wrap=True)
item_7 = ListItem(List=item_3, Index=0, Wrap=True)
item_8 = ListItem(List=item_3, Index=0, Wrap=True)
item_9 = ListItem(List=item_5, Index=2, Wrap=True)
item_10 = ListItem(List=item_5, Index=3, Wrap=True)
item_11 = ListItem(List=item_3, Index=0, Wrap=True)
item_12 = ListItem(List=item_3, Index=0, Wrap=True)
item_13 = ListItem(List=item_5, Index=1, Wrap=True)
item_14 = ListItem(List=item_5, Index=0, Wrap=True)
item_15 = ListItem(List=item_4, Index=2, Wrap=True)
item_16 = ListItem(List=item_4, Index=1, Wrap=True)
item_17 = ListItem(List=item_4, Index=0, Wrap=True)
item_18 = ListItem(List=item_4, Index=3, Wrap=True)
panel_5 = Panel("""0
1
2
3
4
5
6
7
8
9
10
11
12""")
panel_6 = Panel("""0
1
2
3
4
5
6
7
8
9
10
11
12""")
replace = ReplaceItems(
    List=panel_6,
    Item=[item_7, item_17, item_14, item_11, item_16, item_13, item_12, item_9, item_15, item_8, item_10, item_18, item_6],
    Indices=panel_5,
    Wrap=False)

# ----
_5_final_coordinate_list_for_one_frame = Panel(replace)

mesh_2 = Mesh([<mesh referenced from the Rhino model> x4])
demesh_2 = DeconstructMesh(Mesh=mesh_2)  # -> Vertices, Faces, Colours, Normals
pt_2 = Point(demesh_2.Vertices)
panel_7 = Panel("""0
1""")
# Frame 3
panel_8 = Panel("""0
2""")
panel_9 = Panel("""0
1
2
3
4
5
6
7
8
9
10
11
12""")
panel_10 = Panel("""0
1
2
3
4
5
6
7
8
9
10
11
12""")

# ---- group: remove repeats
cset_2 = CreateSet(List=pt_2)  # -> Set, Map

# ----
item_19 = ListItem(List=cset_2.Set, Index=panel_7, Wrap=True)
# Frame 2
panel_11 = Panel(item_19)
item_20 = ListItem(List=cset_2.Set, Index=panel_8, Wrap=True)
panel_12 = Panel(item_20)
item_21 = ListItem(List=item_19, Index=1, Wrap=True)  # -> flatten(Item)
item_22 = ListItem(List=item_19, Index=0, Wrap=True)  # -> flatten(Item)
item_23 = ListItem(List=item_20, Index=1, Wrap=True)  # -> flatten(Item)
item_24 = ListItem(List=item_22, Index=0, Wrap=True)
item_25 = ListItem(List=item_22, Index=0, Wrap=True)
item_26 = ListItem(List=item_22, Index=0, Wrap=True)
item_27 = ListItem(List=item_22, Index=0, Wrap=True)
item_28 = ListItem(List=item_21, Index=2, Wrap=True)
item_29 = ListItem(List=item_21, Index=1, Wrap=True)
item_30 = ListItem(List=item_23, Index=2, Wrap=True)
item_31 = ListItem(List=item_23, Index=3, Wrap=True)
item_32 = ListItem(List=item_21, Index=0, Wrap=True)
item_33 = ListItem(List=item_23, Index=1, Wrap=True)
item_34 = ListItem(List=item_21, Index=3, Wrap=True)
item_35 = ListItem(List=item_22, Index=0, Wrap=True)
item_36 = ListItem(List=item_23, Index=0, Wrap=True)
replace_2 = ReplaceItems(
    List=panel_9,
    Item=[item_35, item_32, item_36, item_26, item_29, item_33, item_27, item_30, item_28, item_25, item_31, item_34, item_24],
    Indices=panel_10,
    Wrap=False)
panel_13 = Panel(replace_2)

mesh_3 = Mesh([<mesh referenced from the Rhino model> x4])
demesh_3 = DeconstructMesh(Mesh=mesh_3)  # -> Vertices, Faces, Colours, Normals
pt_3 = Point(demesh_3.Vertices)
panel_14 = Panel("""0
1""")
panel_15 = Panel("""0
2""")
panel_16 = Panel("""0
1
2
3
4
5
6
7
8
9
10
11
12""")
panel_17 = Panel("""0
1
2
3
4
5
6
7
8
9
10
11
12""")

# ---- group: remove repeats
cset_3 = CreateSet(List=pt_3)  # -> Set, Map

# ----
item_37 = ListItem(List=cset_3.Set, Index=panel_14, Wrap=True)
# Frame 4
panel_18 = Panel(item_37)
item_38 = ListItem(List=cset_3.Set, Index=panel_15, Wrap=True)
panel_19 = Panel(item_38)
item_39 = ListItem(List=item_37, Index=1, Wrap=True)  # -> flatten(Item)
item_40 = ListItem(List=item_37, Index=0, Wrap=True)  # -> flatten(Item)
item_41 = ListItem(List=item_38, Index=1, Wrap=True)  # -> flatten(Item)
item_42 = ListItem(List=item_39, Index=2, Wrap=True)
item_43 = ListItem(List=item_40, Index=0, Wrap=True)
item_44 = ListItem(List=item_39, Index=1, Wrap=True)
item_45 = ListItem(List=item_41, Index=2, Wrap=True)
item_46 = ListItem(List=item_41, Index=3, Wrap=True)
item_47 = ListItem(List=item_41, Index=1, Wrap=True)
item_48 = ListItem(List=item_40, Index=0, Wrap=True)
item_49 = ListItem(List=item_39, Index=0, Wrap=True)
item_50 = ListItem(List=item_39, Index=3, Wrap=True)
item_51 = ListItem(List=item_41, Index=0, Wrap=True)
item_52 = ListItem(List=item_40, Index=0, Wrap=True)
item_53 = ListItem(List=item_40, Index=0, Wrap=True)
item_54 = ListItem(List=item_40, Index=0, Wrap=True)
replace_3 = ReplaceItems(
    List=panel_16,
    Item=[item_54, item_49, item_51, item_52, item_44, item_47, item_53, item_45, item_42, item_48, item_46, item_50, item_43],
    Indices=panel_17,
    Wrap=False)
panel_20 = Panel(replace_3)

mesh_4 = Mesh([<mesh referenced from the Rhino model> x4])
demesh_4 = DeconstructMesh(Mesh=mesh_4)  # -> Vertices, Faces, Colours, Normals
pt_4 = Point(demesh_4.Vertices)
panel_21 = Panel("""0
1""")
panel_22 = Panel("""0
2""")
panel_23 = Panel("""0
1
2
3
4
5
6
7
8
9
10
11
12""")
panel_24 = Panel("""0
1
2
3
4
5
6
7
8
9
10
11
12""")

# ---- group: remove repeats
cset_4 = CreateSet(List=pt_4)  # -> Set, Map

# ----
item_55 = ListItem(List=cset_4.Set, Index=panel_21, Wrap=True)
panel_25 = Panel(item_55)
item_56 = ListItem(List=cset_4.Set, Index=panel_22, Wrap=True)
panel_26 = Panel(item_56)
item_57 = ListItem(List=item_55, Index=1, Wrap=True)  # -> flatten(Item)
item_58 = ListItem(List=item_55, Index=0, Wrap=True)  # -> flatten(Item)
item_59 = ListItem(List=item_56, Index=1, Wrap=True)  # -> flatten(Item)
item_60 = ListItem(List=item_58, Index=0, Wrap=True)
item_61 = ListItem(List=item_58, Index=0, Wrap=True)
item_62 = ListItem(List=item_58, Index=0, Wrap=True)
item_63 = ListItem(List=item_58, Index=0, Wrap=True)
item_64 = ListItem(List=item_57, Index=2, Wrap=True)
item_65 = ListItem(List=item_57, Index=1, Wrap=True)
item_66 = ListItem(List=item_58, Index=0, Wrap=True)
item_67 = ListItem(List=item_57, Index=0, Wrap=True)
item_68 = ListItem(List=item_57, Index=3, Wrap=True)
item_69 = ListItem(List=item_59, Index=2, Wrap=True)
item_70 = ListItem(List=item_59, Index=3, Wrap=True)
item_71 = ListItem(List=item_59, Index=1, Wrap=True)
item_72 = ListItem(List=item_59, Index=0, Wrap=True)
replace_4 = ReplaceItems(
    List=panel_23,
    Item=[item_66, item_67, item_72, item_62, item_65, item_71, item_63, item_69, item_64, item_61, item_70, item_68, item_60],
    Indices=panel_24,
    Wrap=False)
panel_27 = Panel(replace_4)

mesh_5 = Mesh([<mesh referenced from the Rhino model> x4])
# Frame 7
demesh_5 = DeconstructMesh(Mesh=mesh_5)  # -> Vertices, Faces, Colours, Normals
pt_5 = Point(demesh_5.Vertices)
panel_28 = Panel("""0
1""")
panel_29 = Panel("""0
2""")
panel_30 = Panel("""0
1
2
3
4
5
6
7
8
9
10
11
12""")
panel_31 = Panel("""0
1
2
3
4
5
6
7
8
9
10
11
12""")

# ---- group: remove repeats
cset_5 = CreateSet(List=pt_5)  # -> Set, Map

# ----
item_73 = ListItem(List=cset_5.Set, Index=panel_28, Wrap=True)
panel_32 = Panel(item_73)
item_74 = ListItem(List=cset_5.Set, Index=panel_29, Wrap=True)
panel_33 = Panel(item_74)
item_75 = ListItem(List=item_73, Index=0, Wrap=True)  # -> flatten(Item)
item_76 = ListItem(List=item_73, Index=1, Wrap=True)  # -> flatten(Item)
item_77 = ListItem(List=item_74, Index=1, Wrap=True)  # -> flatten(Item)
item_78 = ListItem(List=item_75, Index=0, Wrap=True)
item_79 = ListItem(List=item_75, Index=0, Wrap=True)
item_80 = ListItem(List=item_75, Index=0, Wrap=True)
item_81 = ListItem(List=item_75, Index=0, Wrap=True)
item_82 = ListItem(List=item_75, Index=0, Wrap=True)
item_83 = ListItem(List=item_76, Index=2, Wrap=True)
item_84 = ListItem(List=item_76, Index=1, Wrap=True)
item_85 = ListItem(List=item_76, Index=0, Wrap=True)
item_86 = ListItem(List=item_76, Index=3, Wrap=True)
item_87 = ListItem(List=item_77, Index=2, Wrap=True)
item_88 = ListItem(List=item_77, Index=3, Wrap=True)
item_89 = ListItem(List=item_77, Index=1, Wrap=True)
item_90 = ListItem(List=item_77, Index=0, Wrap=True)
replace_5 = ReplaceItems(
    List=panel_30,
    Item=[item_82, item_85, item_90, item_80, item_84, item_89, item_81, item_87, item_83, item_79, item_88, item_86, item_78],
    Indices=panel_31,
    Wrap=False)
panel_34 = Panel(replace_5)

mesh_6 = Mesh([<mesh referenced from the Rhino model> x8])
# Frame 6
demesh_6 = DeconstructMesh(Mesh=mesh_6)  # -> Vertices, Faces, Colours, Normals
pt_6 = Point(demesh_6.Vertices)
panel_35 = Panel("""0
1""")
panel_36 = Panel("""0
2""")
panel_37 = Panel("""0
1
2
3
4
5
6
7
8
9
10
11
12""")
panel_38 = Panel("""0
1
2
3
4
5
6
7
8
9
10
11
12""")

# ---- group: remove repeats
cset_6 = CreateSet(List=pt_6)  # -> Set, Map

# ----
item_91 = ListItem(List=cset_6.Set, Index=panel_35, Wrap=True)
panel_39 = Panel(item_91)
item_92 = ListItem(List=cset_6.Set, Index=panel_36, Wrap=True)
panel_40 = Panel(item_92)
item_93 = ListItem(List=item_91, Index=1, Wrap=True)  # -> flatten(Item)
item_94 = ListItem(List=item_91, Index=0, Wrap=True)  # -> flatten(Item)
item_95 = ListItem(List=item_92, Index=1, Wrap=True)  # -> flatten(Item)
item_96 = ListItem(List=item_94, Index=0, Wrap=True)
item_97 = ListItem(List=item_95, Index=2, Wrap=True)
item_98 = ListItem(List=item_95, Index=3, Wrap=True)
item_99 = ListItem(List=item_94, Index=0, Wrap=True)
item_100 = ListItem(List=item_95, Index=1, Wrap=True)
item_101 = ListItem(List=item_94, Index=0, Wrap=True)
item_102 = ListItem(List=item_94, Index=0, Wrap=True)
item_103 = ListItem(List=item_95, Index=0, Wrap=True)
item_104 = ListItem(List=item_93, Index=2, Wrap=True)
item_105 = ListItem(List=item_93, Index=1, Wrap=True)
item_106 = ListItem(List=item_94, Index=0, Wrap=True)
item_107 = ListItem(List=item_93, Index=0, Wrap=True)
item_108 = ListItem(List=item_93, Index=3, Wrap=True)
replace_6 = ReplaceItems(
    List=panel_37,
    Item=[item_106, item_107, item_103, item_101, item_105, item_100, item_102, item_97, item_104, item_99, item_98, item_108, item_96],
    Indices=panel_38,
    Wrap=False)
panel_41 = Panel(replace_6)

mesh_7 = Mesh([<mesh referenced from the Rhino model> x4])
# Frame 8
demesh_7 = DeconstructMesh(Mesh=mesh_7)  # -> Vertices, Faces, Colours, Normals
pt_7 = Point(demesh_7.Vertices)
panel_42 = Panel("""0
2""")
panel_43 = Panel("""0
1""")
panel_44 = Panel("""0
1
2
3
4
5
6
7
8
9
10
11
12""")
panel_45 = Panel("""0
1
2
3
4
5
6
7
8
9
10
11
12""")

# ---- group: remove repeats
cset_7 = CreateSet(List=pt_7)  # -> Set, Map

# ----
item_109 = ListItem(List=cset_7.Set, Index=panel_43, Wrap=True)
panel_46 = Panel(item_109)
item_110 = ListItem(List=cset_7.Set, Index=panel_42, Wrap=True)
panel_47 = Panel(item_110)
item_111 = ListItem(List=item_109, Index=1, Wrap=True)  # -> flatten(Item)
item_112 = ListItem(List=item_109, Index=0, Wrap=True)  # -> flatten(Item)
item_113 = ListItem(List=item_110, Index=1, Wrap=True)  # -> flatten(Item)
item_114 = ListItem(List=item_111, Index=2, Wrap=True)
item_115 = ListItem(List=item_111, Index=1, Wrap=True)
item_116 = ListItem(List=item_111, Index=0, Wrap=True)
item_117 = ListItem(List=item_111, Index=3, Wrap=True)
item_118 = ListItem(List=item_112, Index=0, Wrap=True)
item_119 = ListItem(List=item_112, Index=0, Wrap=True)
item_120 = ListItem(List=item_113, Index=2, Wrap=True)
item_121 = ListItem(List=item_113, Index=3, Wrap=True)
item_122 = ListItem(List=item_112, Index=0, Wrap=True)
item_123 = ListItem(List=item_112, Index=0, Wrap=True)
item_124 = ListItem(List=item_113, Index=1, Wrap=True)
item_125 = ListItem(List=item_113, Index=0, Wrap=True)
item_126 = ListItem(List=item_112, Index=0, Wrap=True)
replace_7 = ReplaceItems(
    List=panel_44,
    Item=[item_126, item_116, item_125, item_122, item_115, item_124, item_123, item_120, item_114, item_119, item_121, item_117, item_118],
    Indices=panel_45,
    Wrap=False)
panel_48 = Panel(replace_7)

mesh_8 = Mesh([<mesh referenced from the Rhino model> x4])
demesh_8 = DeconstructMesh(Mesh=mesh_8)  # -> Vertices, Faces, Colours, Normals
pt_8 = Point(demesh_8.Vertices)
panel_49 = Panel("""0
1""")
panel_50 = Panel("""0
2""")
panel_51 = Panel("""0
1
2
3
4
5
6
7
8
9
10
11
12""")
panel_52 = Panel("""0
1
2
3
4
5
6
7
8
9
10
11
12""")

# ---- group: remove repeats
cset_8 = CreateSet(List=pt_8)  # -> Set, Map

# ----
item_127 = ListItem(List=cset_8.Set, Index=panel_49, Wrap=True)
# Frame 5
panel_53 = Panel(item_127)
item_128 = ListItem(List=cset_8.Set, Index=panel_50, Wrap=True)
panel_54 = Panel(item_128)
item_129 = ListItem(List=item_127, Index=1, Wrap=True)  # -> flatten(Item)
item_130 = ListItem(List=item_127, Index=0, Wrap=True)  # -> flatten(Item)
item_131 = ListItem(List=item_128, Index=1, Wrap=True)  # -> flatten(Item)
item_132 = ListItem(List=item_130, Index=0, Wrap=True)
item_133 = ListItem(List=item_130, Index=0, Wrap=True)
item_134 = ListItem(List=item_130, Index=0, Wrap=True)
item_135 = ListItem(List=item_130, Index=0, Wrap=True)
item_136 = ListItem(List=item_129, Index=2, Wrap=True)
item_137 = ListItem(List=item_129, Index=1, Wrap=True)
item_138 = ListItem(List=item_131, Index=2, Wrap=True)
item_139 = ListItem(List=item_131, Index=3, Wrap=True)
item_140 = ListItem(List=item_129, Index=0, Wrap=True)
item_141 = ListItem(List=item_131, Index=1, Wrap=True)
item_142 = ListItem(List=item_129, Index=3, Wrap=True)
item_143 = ListItem(List=item_130, Index=0, Wrap=True)
item_144 = ListItem(List=item_131, Index=0, Wrap=True)
replace_8 = ReplaceItems(
    List=panel_51,
    Item=[item_143, item_140, item_144, item_134, item_137, item_141, item_135, item_138, item_136, item_133, item_139, item_142, item_132],
    Indices=panel_52,
    Wrap=False)
panel_55 = Panel(replace_8)

mesh_9 = Mesh([<mesh referenced from the Rhino model> x4])
# Frame 11
demesh_9 = DeconstructMesh(Mesh=mesh_9)  # -> Vertices, Faces, Colours, Normals
pt_9 = Point(demesh_9.Vertices)
panel_56 = Panel("""0
1""")
panel_57 = Panel("""0
2""")
panel_58 = Panel("""0
1
2
3
4
5
6
7
8
9
10
11
12""")
panel_59 = Panel("""0
1
2
3
4
5
6
7
8
9
10
11
12""")

# ---- group: remove repeats
cset_9 = CreateSet(List=pt_9)  # -> Set, Map

# ----
item_145 = ListItem(List=cset_9.Set, Index=panel_56, Wrap=True)
panel_60 = Panel(item_145)
item_146 = ListItem(List=cset_9.Set, Index=panel_57, Wrap=True)
panel_61 = Panel(item_146)
item_147 = ListItem(List=item_145, Index=1, Wrap=True)  # -> flatten(Item)
item_148 = ListItem(List=item_145, Index=0, Wrap=True)  # -> flatten(Item)
item_149 = ListItem(List=item_146, Index=1, Wrap=True)  # -> flatten(Item)
item_150 = ListItem(List=item_148, Index=0, Wrap=True)
item_151 = ListItem(List=item_148, Index=0, Wrap=True)
item_152 = ListItem(List=item_148, Index=0, Wrap=True)
item_153 = ListItem(List=item_148, Index=0, Wrap=True)
item_154 = ListItem(List=item_147, Index=2, Wrap=True)
item_155 = ListItem(List=item_148, Index=0, Wrap=True)
item_156 = ListItem(List=item_147, Index=1, Wrap=True)
item_157 = ListItem(List=item_147, Index=0, Wrap=True)
item_158 = ListItem(List=item_147, Index=3, Wrap=True)
item_159 = ListItem(List=item_149, Index=2, Wrap=True)
item_160 = ListItem(List=item_149, Index=3, Wrap=True)
item_161 = ListItem(List=item_149, Index=1, Wrap=True)
item_162 = ListItem(List=item_149, Index=0, Wrap=True)
replace_9 = ReplaceItems(
    List=panel_59,
    Item=[item_155, item_157, item_162, item_152, item_156, item_161, item_153, item_159, item_154, item_151, item_160, item_158, item_150],
    Indices=panel_58,
    Wrap=False)
panel_62 = Panel(replace_9)

mesh_10 = Mesh([<mesh referenced from the Rhino model> x4])
# Frame 9
demesh_10 = DeconstructMesh(Mesh=mesh_10)  # -> Vertices, Faces, Colours, Normals
pt_10 = Point(demesh_10.Vertices)
panel_63 = Panel("""0
1""")
# Frame 10
panel_64 = Panel("""0
2""")
panel_65 = Panel("""0
1
2
3
4
5
6
7
8
9
10
11
12""")
panel_66 = Panel("""0
1
2
3
4
5
6
7
8
9
10
11
12""")

# ---- group: remove repeats
cset_10 = CreateSet(List=pt_10)  # -> Set, Map

# ----
item_163 = ListItem(List=cset_10.Set, Index=panel_63, Wrap=True)
panel_67 = Panel(item_163)
item_164 = ListItem(List=cset_10.Set, Index=panel_64, Wrap=True)
panel_68 = Panel(item_164)
item_165 = ListItem(List=item_163, Index=1, Wrap=True)  # -> flatten(Item)
item_166 = ListItem(List=item_163, Index=0, Wrap=True)  # -> flatten(Item)
item_167 = ListItem(List=item_164, Index=1, Wrap=True)  # -> flatten(Item)
item_168 = ListItem(List=item_165, Index=2, Wrap=True)
item_169 = ListItem(List=item_165, Index=1, Wrap=True)
item_170 = ListItem(List=item_165, Index=0, Wrap=True)
item_171 = ListItem(List=item_166, Index=0, Wrap=True)
item_172 = ListItem(List=item_165, Index=3, Wrap=True)
item_173 = ListItem(List=item_166, Index=0, Wrap=True)
item_174 = ListItem(List=item_167, Index=2, Wrap=True)
item_175 = ListItem(List=item_167, Index=3, Wrap=True)
item_176 = ListItem(List=item_167, Index=1, Wrap=True)
item_177 = ListItem(List=item_166, Index=0, Wrap=True)
item_178 = ListItem(List=item_166, Index=0, Wrap=True)
item_179 = ListItem(List=item_167, Index=0, Wrap=True)
item_180 = ListItem(List=item_166, Index=0, Wrap=True)
replace_10 = ReplaceItems(
    List=panel_65,
    Item=[item_180, item_170, item_179, item_177, item_169, item_176, item_178, item_174, item_168, item_173, item_175, item_172, item_171],
    Indices=panel_66,
    Wrap=False)
panel_69 = Panel(replace_10)

mesh_11 = Mesh([<mesh referenced from the Rhino model> x4])
demesh_11 = DeconstructMesh(Mesh=mesh_11)  # -> Vertices, Faces, Colours, Normals
pt_11 = Point(demesh_11.Vertices)
panel_70 = Panel("""0
1""")
panel_71 = Panel("""0
2""")
panel_72 = Panel("""0
1
2
3
4
5
6
7
8
9
10
11
12""")
panel_73 = Panel("""0
1
2
3
4
5
6
7
8
9
10
11
12""")

# ---- group: remove repeats
cset_11 = CreateSet(List=pt_11)  # -> Set, Map

# ----
item_181 = ListItem(List=cset_11.Set, Index=panel_70, Wrap=True)
panel_74 = Panel(item_181)
item_182 = ListItem(List=cset_11.Set, Index=panel_71, Wrap=True)
panel_75 = Panel(item_182)
item_183 = ListItem(List=item_181, Index=1, Wrap=True)  # -> flatten(Item)
item_184 = ListItem(List=item_181, Index=0, Wrap=True)  # -> flatten(Item)
item_185 = ListItem(List=item_182, Index=1, Wrap=True)  # -> flatten(Item)
item_186 = ListItem(List=item_183, Index=2, Wrap=True)
item_187 = ListItem(List=item_183, Index=1, Wrap=True)
item_188 = ListItem(List=item_183, Index=0, Wrap=True)
item_189 = ListItem(List=item_183, Index=3, Wrap=True)
item_190 = ListItem(List=item_185, Index=2, Wrap=True)
item_191 = ListItem(List=item_185, Index=3, Wrap=True)
item_192 = ListItem(List=item_185, Index=1, Wrap=True)
item_193 = ListItem(List=item_184, Index=0, Wrap=True)
item_194 = ListItem(List=item_185, Index=0, Wrap=True)
item_195 = ListItem(List=item_184, Index=0, Wrap=True)
item_196 = ListItem(List=item_184, Index=0, Wrap=True)
item_197 = ListItem(List=item_184, Index=0, Wrap=True)
item_198 = ListItem(List=item_184, Index=0, Wrap=True)
replace_11 = ReplaceItems(
    List=panel_72,
    Item=[item_198, item_188, item_194, item_196, item_187, item_192, item_197, item_190, item_186, item_195, item_191, item_189, item_193],
    Indices=panel_73,
    Wrap=False)
panel_76 = Panel(replace_11)
